# Grasshopper definition building_generator.gh (Grasshopper 1.0.7)

# ---- group: Transformation rules
ground_floor_rotate_angle = Slider(0, range=-2..2)
ground_floor_scale_factor = Slider(1, range=0.5..1.5)
roof_rotate_angle = Slider(0, range=-2..2)
roof_scale_factor = Slider(1, range=0.5..1.5)

# ----
number_slider = Slider(4, range=3..4)

# ---- group: Genes
building_storey = Slider(20, range=20..30)
floor_height = Slider(5, range=4..6)
ground_floor_geometry = Curve(<curve referenced from the Rhino model>)

# ----
number_slider_2 = Slider(46.97, range=25..50)
number_slider_3 = Slider(18, range=-20..20)
number_slider_4 = Slider(6, range=-20..20)
number_slider_5 = Slider(-3, range=-20..20)
number_slider_6 = Slider(-3, range=-20..20)
number_slider_7 = Slider(1, range=-20..20)
number_slider_8 = Slider(-20, range=-20..20)
number_slider_9 = Slider(18, range=-20..20)
number_slider_10 = Slider(-9, range=-20..20)
polygon = Polygon(Plane=PlaneXY(0, 0, 0), Radius=number_slider_2, Segments=number_slider, FilletRadius=0)  # -> Polygon, Length

# ---- group: Gorund floor center point
ground_floor_geometry_2 = Curve(ground_floor_geometry)
topoly = CurveToPolyline(Curve=ground_floor_geometry_2, ToleranceDistance=0, ToleranceAngle=0)  # -> Polyline, Segments
pcen = PolygonCenter(Polyline=topoly.Polyline)  # -> CenterV, CenterE, CenterA
gf_center_point = Point(pcen.CenterV)

# ----
crv = Curve(polygon.Polygon)
number_slider_11 = Slider(6, range=1..8)
number_slider_12 = Slider(3, range=1..8)
number_slider_13 = Slider(3, range=1..8)
number_slider_14 = Slider(1, range=1..8)

# ---- group: Building height
building_storey_2 = Number(building_storey)
floor_height_2 = Number(floor_height)
multiplication = Multiplication(BuildingStorey=building_storey_2, FloorHeight=floor_height_2)
building_height = Number(multiplication)
panel = Panel(building_height)

# ----
explode = Explode(Curve=crv, Recursive=True)  # -> Segments, Vertices
item = ListItem(List=explode.Vertices, Index=number_slider_12, Wrap=True)
item_2 = ListItem(List=explode.Vertices, Index=number_slider_11, Wrap=True)
item_3 = ListItem(List=explode.Vertices, Index=number_slider_13, Wrap=True)
item_4 = ListItem(List=explode.Vertices, Index=number_slider_14, Wrap=True)
vec = VectorXYZ(XComponent=number_slider_7, YComponent=number_slider_4, ZComponent=0)  # -> Vector, Length
vec_2 = VectorXYZ(XComponent=number_slider_5, YComponent=number_slider_3, ZComponent=0)  # -> Vector, Length
vec_3 = VectorXYZ(XComponent=number_slider_8, YComponent=number_slider_6, ZComponent=0)  # -> Vector, Length
vec_4 = VectorXYZ(XComponent=number_slider_10, YComponent=number_slider_9, ZComponent=0)  # -> Vector, Length
move = Move(Geometry=item, Motion=vec.Vector)  # -> Geometry, Transform
move_2 = Move(Geometry=item_2, Motion=vec_2.Vector)  # -> Geometry, Transform
move_3 = Move(Geometry=item_3, Motion=vec_3.Vector)  # -> Geometry, Transform
move_4 = Move(Geometry=item_4, Motion=vec_4.Vector)  # -> Geometry, Transform
pt = Point(move_2.Geometry)
panel_2 = Panel(item_2)

# ---- group: Ground floor geometry scale
gf_center_point_2 = Point(gf_center_point)
ground_floor_scale_factor_2 = Number(ground_floor_scale_factor)
gf_geometry = Curve(ground_floor_geometry)
scale = Scale(Geometry=gf_geometry, Center=gf_center_point_2, Factor=ground_floor_scale_factor_2)  # -> Geometry, Transform

# ---- group: Roof center point
building_height_2 = Number(panel)
gf_center_point_3 = Point(gf_center_point)
Z = UnitZ(Factor=building_height_2)
move_5 = Move(Geometry=gf_center_point_3, Motion=Z)  # -> Geometry, Transform

# ----
pline = PolyLine(Vertices=[move_2.Geometry, move_3.Geometry, move_4.Geometry, move.Geometry, pt], Closed=False)
len = Length(Curve=pline)

# ---- group: Roof geometry
building_height_3 = Number(panel)
ground_floor_geometry_3 = Curve(ground_floor_geometry)
Z_2 = UnitZ(Factor=building_height_3)
move_6 = Move(Geometry=ground_floor_geometry_3, Motion=Z_2)  # -> Geometry, Transform

# ---- group: Roof geometry scale
roof_center_point = Point(move_5.Geometry)
roof_scale_factor_2 = Number(roof_scale_factor)
roof_geometry = Curve(move_6.Geometry)
scale_2 = Scale(Geometry=roof_geometry, Center=roof_center_point, Factor=roof_scale_factor_2)  # -> Geometry, Transform

# ----
galapagos = Galapagos(
    fitness=len,
    gene=[number_slider, number_slider_2, number_slider_11, number_slider_5, number_slider_3, number_slider_13, number_slider_8, number_slider_6, number_slider_14, number_slider_10, number_slider_9, number_slider_12, number_slider_7, number_slider_4])
panel_3 = Panel(len)

# ---- group: Roof geometry rotate
roof_rotate_angle_2 = Number(roof_rotate_angle)
roof_plane = Plane(move_5.Geometry)
rotate = Rotate(Geometry=scale_2.Geometry, Angle=roof_rotate_angle_2, Plane=roof_plane)  # -> Geometry, Transform

# ---- group: Ground floor geometry rotate
gf_center_point_4 = Point(gf_center_point)
gf_rotate_angle = Number(ground_floor_rotate_angle)
rotate_2 = Rotate(Geometry=scale.Geometry, Angle=gf_rotate_angle, Plane=gf_center_point_4)  # -> Geometry, Transform

# ---- group: Building mass
ground_floor = Curve(rotate_2.Geometry)
roof = Curve(rotate.Geometry)
loft = Loft(
    Curves=[roof, ground_floor],
    Options={Adjust=False, Closed=False, LoftEnds=0, LoftSimp=0, LoftType=0, Rebuild=10, Refit=0.01})
cap = CapHoles(Brep=loft)
preview = CustomPreview(Geometry=cap, Material=ColourSwatch(SwatchColor=RGB(176, 255, 229)))

# ---- group: Ground floor area
ground_floor_geometry_4 = Curve(ground_floor_geometry)
area = Area(Geometry=ground_floor_geometry_4)  # -> BuildingArea, Centroid

# ----
building_area = Number(area.BuildingArea)

# ---- group: Ground floor area (continued)
panel_4 = Panel(building_area)

# ---- group: Floors
building_mass = Brep(cap)
floor_height_3 = Number(floor_height)
contour = Contour(Shape=building_mass, Point=Point(0, 0, 0), Direction=Vector(0, 0, 1), Distance=floor_height_3)  # -> flatten(Contours)
area_2 = Area(Geometry=contour)  # -> Area, Centroid
ma = MassAddition(Input=area_2.Area)  # -> Result, PartialResults
panel_5 = Panel(area_2.Area)

# ----
total_area = Number(ma.Result)
total_area_2 = Number(total_area)
int = Integer(total_area_2)
panel_6 = Panel(int)

# ---- group: Floors (continued)
panel_7 = Panel(total_area)
