# Grasshopper definition form_generator.gh (Grasshopper 1.0.7)

# ---- group: Ground floor geometry
crv = Curve(<curve referenced from the Rhino model>)
explode = Explode(Curve=crv, Recursive=True)  # -> Segments, Vertices
pt = Point(graft(explode.Vertices))
bang = ExplodeTree(Data=pt)  # -> Branch0, Branch1, Branch2, Branch3, Branch4
pt_2 = Point(flatten(bang.Branch0))
pt_3 = Point(flatten(bang.Branch1))
pt_4 = Point(flatten(bang.Branch2))
pt_5 = Point(flatten(bang.Branch3))
pt_6 = Point(flatten(pt_2))
merge = Merge(Data1=pt_2, Data2=pt_3, Data3=pt_4, Data4=pt_5, Data5=pt_6)
pline = PolyLine(Vertices=merge, Closed=False)

# ---- group: Genes
building_storey = Slider(25, range=20..30)
floor_height = Slider(5, range=4..6)
ground_floor_geometry = Curve(pline)

# ---- group: Building height
building_storey_2 = Number(building_storey)
floor_height_2 = Number(floor_height)
multiplication = Multiplication(BuildingStorey=building_storey_2, FloorHeight=floor_height_2)
building_height = Number(multiplication)
panel = Panel(building_height)

# ---- group: Roof geometry
building_height_2 = Number(panel)
ground_floor_geometry_2 = Curve(ground_floor_geometry)
Z = UnitZ(Factor=building_height_2)
move = Move(Geometry=ground_floor_geometry_2, Motion=Z)  # -> Geometry, Transform

# ---- group: Explode roof geometry
crv_2 = Curve(move.Geometry)
explode_2 = Explode(Curve=crv_2, Recursive=True)  # -> Segments, Vertices
pt_7 = Point(graft(explode_2.Vertices))
bang_2 = ExplodeTree(Data=pt_7)  # -> Branch0, Branch1, Branch2, Branch3, Branch4
pt_8 = Point(flatten(bang_2.Branch0))
pt_9 = Point(flatten(bang_2.Branch1))
pt_10 = Point(flatten(bang_2.Branch2))
pt_11 = Point(flatten(bang_2.Branch3))

# ---- group: Expand
pt_12 = Point(pt_10)
pt_13 = Point(pt_11)
pt_14 = Point(pt_8)
pt_15 = Point(pt_9)
merge_2 = Merge(Data1=pt_14, Data2=pt_15, Data3=pt_12, Data4=pt_13, Data5=pt_14)
pline_2 = PolyLine(Vertices=merge_2, Closed=False)
pt_16 = Point(pt_13)
pt_17 = Point(pt_12)
pt_18 = Point(pt_14)
pt_19 = Point(pt_15)
vec = VectorXYZ(XComponent=0, YComponent=Slider(0, range=-20..20), ZComponent=Slider(-10, range=-20..20))  # -> Vector, Length
vec_2 = VectorXYZ(XComponent=0, YComponent=Slider(0, range=-20..20), ZComponent=Slider(-10, range=-20..20))  # -> Vector, Length
move_2 = Move(Geometry=pt_18, Motion=vec.Vector)  # -> Geometry, Transform
move_3 = Move(Geometry=pt_19, Motion=vec.Vector)  # -> Geometry, Transform
move_4 = Move(Geometry=pt_17, Motion=vec_2.Vector)  # -> Geometry, Transform
move_5 = Move(Geometry=pt_16, Motion=vec_2.Vector)  # -> Geometry, Transform
vec_3 = VectorXYZ(XComponent=Slider(0, range=-20..10), YComponent=0, ZComponent=Slider(0, range=-20..10))  # -> Vector, Length
vec_4 = VectorXYZ(XComponent=Slider(0, range=-20..10), YComponent=0, ZComponent=Slider(0, range=-20..10))  # -> Vector, Length
move_6 = Move(Geometry=move_2.Geometry, Motion=vec_4.Vector)  # -> Geometry, Transform
move_7 = Move(Geometry=move_3.Geometry, Motion=vec_3.Vector)  # -> Geometry, Transform
move_8 = Move(Geometry=move_4.Geometry, Motion=vec_3.Vector)  # -> Geometry, Transform
move_9 = Move(Geometry=move_5.Geometry, Motion=vec_4.Vector)  # -> Geometry, Transform
move_10 = Move(Geometry=[move_6.Geometry, move_9.Geometry], Motion=Vector(0, 0, 10))  # -> graft(Geometry), Transform
move_11 = Move(Geometry=[move_6.Geometry, move_7.Geometry], Motion=Vector(0, 0, 10))  # -> graft(Geometry), Transform
move_12 = Move(Geometry=[move_7.Geometry, move_8.Geometry], Motion=Vector(0, 0, 10))  # -> graft(Geometry), Transform
move_13 = Move(Geometry=[move_8.Geometry, move_9.Geometry], Motion=Vector(0, 0, 10))  # -> graft(Geometry), Transform
bang_3 = ExplodeTree(Data=move_10.Geometry)  # -> flatten(Branch0), Branch1
bang_4 = ExplodeTree(Data=move_11.Geometry)  # -> Branch0, flatten(Branch1)
bang_5 = ExplodeTree(Data=move_12.Geometry)  # -> Branch0, flatten(Branch1)
bang_6 = ExplodeTree(Data=move_13.Geometry)  # -> Branch0, flatten(Branch1)
ln = Line(StartPoint=bang_4.Branch0, EndPoint=bang_4.Branch1)
ln_2 = Line(StartPoint=bang_6.Branch0, EndPoint=bang_6.Branch1)
ln_3 = Line(StartPoint=bang_3.Branch0, EndPoint=bang_3.Branch1)
ln_4 = Line(StartPoint=bang_5.Branch0, EndPoint=bang_5.Branch1)
pline_3 = PolyLine(Vertices=[bang_3.Branch0, bang_4.Branch1, bang_5.Branch1, bang_6.Branch1], Closed=True)
crv_3 = Curve(pline_3)

# ----
explode_3 = Explode(Curve=crv_3, Recursive=True)  # -> Segments, Vertices
pt_20 = Point(graft(explode_3.Vertices))
bang_7 = ExplodeTree(Data=pt_20)  # -> Branch0, Branch1, Branch2, Branch3, Branch4
pt_21 = Point(flatten(bang_7.Branch0))
pt_22 = Point(flatten(bang_7.Branch1))
pt_23 = Point(flatten(bang_7.Branch2))
pt_24 = Point(flatten(bang_7.Branch3))
ln_5 = Line(StartPoint=pt_21, EndPoint=pt_22)
ln_6 = Line(StartPoint=pt_22, EndPoint=pt_23)
ln_7 = Line(StartPoint=pt_23, EndPoint=pt_24)
ln_8 = Line(StartPoint=pt_24, EndPoint=pt_21)
divide = DivideCurve(Curve=ln_5, Count=2, Kinks=False)  # -> Points, Tangents, Parameters
divide_2 = DivideCurve(Curve=ln_6, Count=2, Kinks=False)  # -> Points, Tangents, Parameters
divide_3 = DivideCurve(Curve=ln_7, Count=2, Kinks=False)  # -> Points, Tangents, Parameters
divide_4 = DivideCurve(Curve=ln_8, Count=2, Kinks=False)  # -> Points, Tangents, Parameters
item = ListItem(List=divide.Points, Index=1, Wrap=True)
item_2 = ListItem(List=divide_2.Points, Index=1, Wrap=True)
item_3 = ListItem(List=divide_3.Points, Index=1, Wrap=True)
item_4 = ListItem(List=divide_4.Points, Index=1, Wrap=True)
Z_2 = UnitZ(Factor=Slider(17, range=0..20))
move_14 = Move(Geometry=item, Motion=Z_2)  # -> Geometry, Transform
move_15 = Move(Geometry=item_3, Motion=Z_2)  # -> Geometry, Transform
pt_25 = Point(flatten(move_14.Geometry))
pt_26 = Point()
pt_27 = Point(flatten(move_15.Geometry))
pt_28 = Point()
pt_29 = Point(pt_24)
pt_30 = Point(pt_21)
pt_31 = Point(pt_22)
pt_32 = Point(pt_23)
pline_4 = PolyLine(Vertices=[pt_30, pt_25, pt_27, pt_29], Closed=True)
pline_5 = PolyLine(Vertices=[pt_25, pt_31, pt_32, pt_27], Closed=True)
pline_6 = PolyLine(Vertices=[pt_30, pt_25, pt_31, pt_32, pt_27, pt_29], Closed=True)
crv_4 = Curve(pline_6)

# ---- group: Ground floor area
ground_floor_geometry_3 = Curve(ground_floor_geometry)
area = Area(Geometry=ground_floor_geometry_3)  # -> BuildingArea, Centroid

# ----
building_area = Number(area.BuildingArea)

# ---- group: Ground floor area (continued)
panel_2 = Panel(building_area)

# ---- group: Building mass
ground_floor = Curve(ground_floor_geometry)
Z_3 = UnitZ(Factor=1)
roof = Curve(crv_3)
loft = Loft(
    Curves=[ground_floor, roof],
    Options={Adjust=False, Closed=False, LoftEnds=0, LoftSimp=0, LoftType=0, Rebuild=10, Refit=0.01})

# ----
srf = Surface(roof)
cap = CapHoles(Brep=loft)

# ---- group: Building mass (continued)
move_16 = Move(Geometry=srf, Motion=Z_3)  # -> Geometry, Transform
loft_2 = Loft(
    Curves=[srf, move_16.Geometry],
    Options={Adjust=False, Closed=False, LoftEnds=0, LoftSimp=0, LoftType=0, Rebuild=10, Refit=0.01})
preview = CustomPreview(Geometry=[cap, move_16.Geometry], Material=ColourSwatch(SwatchColor=RGB(168, 255, 232)))

# ---- group: Floors
building_mass = Brep(cap)
floor_height_3 = Number(floor_height)
contour = Contour(Shape=building_mass, Point=Point(0, 0, 0), Direction=Vector(0, 0, 1), Distance=floor_height_3)  # -> flatten(Contours)
area_2 = Area(Geometry=contour)  # -> Area, Centroid
ma = MassAddition(Input=area_2.Area)  # -> Result, PartialResults
panel_3 = Panel(area_2.Area)

# ----
total_area = Number(ma.Result)

total_area_2 = Number(total_area)
int = Integer(total_area_2)
panel_4 = Panel(int)

# ---- group: Floors (continued)
panel_5 = Panel(total_area)
